# Grasshopper definition icons.gh (Grasshopper 1.0.8)
# plug-ins: Pufferfish, Human, BeingAliveTerrain

number_slider = Slider(100, range=0..1000)
pt = ConstructPoint(XCoordinate=number_slider, YCoordinate=number_slider, ZCoordinate=0)
pt_2 = ConstructPoint(XCoordinate=expr("-x", number_slider), YCoordinate=expr("-x", number_slider), ZCoordinate=0)
number_slider_2 = Slider(21, range=0..100)
number_slider_3 = Slider(3, range=0..10)
rec_2pt = Rectangle2Pt(Plane=PlaneXY(0, 0, 0), PointA=pt, PointB=pt_2, Radius=0)  # -> Rectangle, Length
boundary = BoundarySurfaces(Edges=rec_2pt.Rectangle)
rebsrf = RebuildSurface(Surface=boundary, CountU=number_slider_2, CountV=number_slider_2, DegreeU=number_slider_3, DegreeV=number_slider_3)
mesh = MeshBrep(
    Brep=rebsrf,
    Settings={GridMaxCount=0, GridMinCount=16, JaggedSeams=False, MaxEdgeLength=0, MinEdgeLength=0.0001, MinTolerance=0, Refine=True, RefineAngle=0, RelativeTolerance=0.65, SimplePlanes=True, Tolerance=0})
mesh_2 = Mesh(mesh)
triremesh = TriRemesh(Geometry=mesh_2, Sharp=True, Length=Slider(9, range=0..10), Iterations=50)  # -> Triangulation, Dual, Creases

number_slider_4 = Slider(150, range=0..1000)
multiplication = Multiplication(A=number_slider_4, B=Slider(3, range=0..10))
pt_3 = ConstructPoint(XCoordinate=expr("-x", number_slider_4), YCoordinate=expr("-x", number_slider_4), ZCoordinate=0)
pt_4 = ConstructPoint(XCoordinate=number_slider_4, YCoordinate=number_slider_4, ZCoordinate=0)
series = Series(Start=Slider(1000, range=0..1000), Step=multiplication, Count=10)
rec_2pt_2 = Rectangle2Pt(Plane=PlaneXY(0, 0, 0), PointA=pt_4, PointB=pt_3, Radius=0)  # -> Rectangle, Length
X = UnitX(Factor=series)
move = Move(Geometry=rec_2pt_2.Rectangle, Motion=X)  # -> Geometry, Transform
Y = UnitY(Factor=expr("-x", number_slider_4))
area = Area(Geometry=move.Geometry)  # -> Area, Centroid
move_2 = Move(Geometry=area.Centroid, Motion=Y)  # -> Geometry, Transform

division = Division(A=number_slider, B=Slider(1.5, range=0..10))
debrep = DeconstructBrep(Brep=boundary)  # -> Faces, Edges, Vertices
crv = Curve(debrep.Edges)
item = ListItem(List=crv, Index=Slider(2, range=0..10), Wrap=True)
item_2 = ListItem(List=crv, Index=Slider(0, range=0..10), Wrap=True)
flip = FlipCurve(Curve=item)  # -> Curve, Flag
Y_2 = UnitY(Factor=expr("-x", division))
Y_3 = UnitY(Factor=division)
move_3 = Move(Geometry=item_2, Motion=Y_3)  # -> Geometry, Transform
move_4 = Move(Geometry=flip.Curve, Motion=Y_2)  # -> Geometry, Transform
merge = Merge(Data1=item_2, Data2=move_3.Geometry, Data3=move_4.Geometry, Data4=flip.Curve)
merge_2 = Merge(
    Data1=Slider(0.9, range=0..1),
    Data2=Slider(0.1, range=0..1),
    Data3=Slider(0.8, range=0..1),
    Data4=Slider(0.2, range=0..1))
eval = EvaluateCurve(Curve=reparameterize(merge), Parameter=merge_2)  # -> Point, Tangent, Angle

dom = ConstructDomain(DomainStart=Slider(0, range=0..10), DomainEnd=Slider(35, range=30..80))

# ----
# Creating Mesh Terrain
number_slider_5 = Slider(61, range=-100..100)
merge_3 = Merge(
    Data1=number_slider_5,
    Data2=Slider(58, range=-100..100),
    Data3=Slider(-40, range=-100..100),
    Data4=Slider(-54, range=-100..100))
Z = UnitZ(Factor=merge_3)
move_5 = Move(Geometry=eval.Point, Motion=Z)  # -> Geometry, Transform
batptterrain = TerrainPointEdit(
    Mesh=triremesh.Triangulation,
    Point=move_5.Geometry,
    Strength=Slider(67, range=-100..100),
    BlurDistance=Slider(90, range=0..1000))
mesh_3 = Mesh(batptterrain)

data = Data(mesh_3)

# ----
# FlowLine
number_slider_6 = Slider(195, range=0..1000)
pt_5 = Point([Point(-55.35345073, -33.66424497, 77.08794526), Point(34.15764992, -66.30996082, 77.08794526), Point(-76.01096878, -9.839573655, 77.08794526), Point(-60.14136324, -11.51138215, 77.08794526), Point(-57.68070242, -18.33864786, 77.08794526), Point(73.54771924, -70.00954038, 77.08794526), Point(-46.5031513, -27.33072416, 77.08794526)])
batrainsim = RainSimulation(Mesh=data, Start=pt_5, Steps=number_slider_6, StepSize=1)

batslope = SlopeAnalysis(Mesh=data, GridSize=Slider(5, range=0..10), SlopeBounds=dom, ColorMap="Viridis")  # -> AnalysisMesh, SamplePoints, SlopeValues, SlopeVectors, InBounds
batxsec = CrossSection(Mesh=data, Count=10, Width=10)  # -> Sections, Planes
bnd = Bounds(Numbers=batslope.SlopeValues)
mesh_4 = Mesh(batslope.AnalysisMesh)
smoothpline = SmoothPolyline(Polyline=batrainsim, Strength=1, Times=1)
pt_6 = Point(batslope.SamplePoints)

# ----
# Extract Edge and ISO curves
number_slider_7 = Slider(45, range=0..100)
demesh = DeconstructMesh(Mesh=mesh_3)  # -> Vertices, Faces, Colours, Normals
lng = ListLength(List=demesh.Vertices)
rad = Radians(Degrees=number_slider_7)
sqrt = SquareRoot(Value=lng)
number_slider_8 = Slider(3, range=0..10)
partition = PartitionList(List=demesh.Vertices, Size=sqrt)
subtraction = Subtraction(A=sqrt, B=1)
flip_2 = FlipMatrix(Data=partition)
division_2 = Division(A=subtraction, B=number_slider_8)
intcrv = Interpolate(Vertices=partition, Degree=3, Periodic=False, KnotStyle=1)  # -> flatten(Curve), Length, Domain
intcrv_2 = Interpolate(Vertices=flip_2, Degree=3, Periodic=False, KnotStyle=1)  # -> flatten(Curve), Length, Domain
addition = Addition(A=division_2, B=1)
entwine = Entwine(Branch00=intcrv.Curve, Branch01=intcrv_2.Curve, FlattenInputs=True)
series_2 = Series(Start=0, Step=number_slider_8, Count=addition)
panel = Panel("""0
-1""")
cull_i = CullIndex(List=series_2, Indices=panel, Wrap=True)
# Color each mesh according to height
item_3 = ListItem(List=entwine, Index=panel, Wrap=True)
item_4 = ListItem(List=entwine, Index=cull_i, Wrap=True)
crv_2 = Curve(item_3)
crv_3 = Curve(item_4)
previewlw = CustomPreviewLineweights(Geometry=crv_3, Shader=ColourSwatch(SwatchColor=RGB(0, 0, 0)), Thickness=Slider(2, range=0..10), Absolute=False)
previewlw_2 = CustomPreviewLineweights(Geometry=crv_2, Shader=ColourSwatch(SwatchColor=RGB(0, 0, 0)), Thickness=Slider(7, range=0..10), Absolute=False)

graft = GraftTree(Tree=demesh.Faces, IncludeEmptyLists=True, IncludeNullItems=True)
# Explode Mesh
deface = DeconstructFace(Face=graft)  # -> CornerA, CornerB, CornerC, CornerD
merge_4 = Merge(Data1=deface.CornerA, Data2=deface.CornerB, Data3=deface.CornerC, Data4=deface.CornerD)
equals = Equality(FirstNumber=deface.CornerD, SecondNumber=deface.CornerC)  # -> Equality, Inequality
item_5 = ListItem(List=demesh.Vertices, Index=merge_4, Wrap=True)
addition_2 = Addition(A="2", B=equals.Inequality)
addition_3 = Addition(A="1", B=equals.Inequality)
split = SplitList(List=item_5, Index=addition_3)  # -> ListA, ListB
quad = MeshQuad(CornerA=0, CornerB=1, CornerC="2", CornerD=addition_2)
conmesh = ConstructMesh(Vertices=item_5, Faces=quad)  # -> flatten(Mesh)

facen = FaceNormals(Mesh=conmesh)  # -> flatten(Centers), Normals
pdecon = Deconstruct(Point=facen.Centers)  # -> XComponent, YComponent, ZComponent
avr = Average(Input=pdecon.ZComponent)
subtraction_2 = Subtraction(A=pdecon.ZComponent, B=avr)
sort = SortList(Keys=subtraction_2, ValuesA=conmesh)  # -> Keys, ValuesA
faceb = FaceBoundaries(Mesh=conmesh)  # -> flatten(Boundaries)
item_6 = ListItem(List=sort.Keys, Index=-1, Wrap=True)
item_7 = ListItem(List=sort.Keys, Index=0, Wrap=True)
dom_2 = ConstructDomain(DomainStart=item_7, DomainEnd=item_6)
remap = RemapNumbers(Value=sort.Keys, Source=dom_2, Target=Domain(0, 1))  # -> Mapped, Clipped
sort_2 = SortList(Keys=subtraction_2, ValuesA=faceb)  # -> Keys, ValuesA
gradient = Gradient(
    LowerLimit=0,
    UpperLimit=1,
    Parameter=remap.Mapped,
    stops=[0: RGB(228, 87, 46), 0.0243: RGB(228, 87, 46), 0.295: RGB(240, 246, 110), 0.4: RGB(240, 247, 172), 0.6: RGB(240, 248, 234), 0.703: RGB(204, 223, 184), 1: RGB(115, 153, 72)])
crv_4 = Curve(graft(sort_2.ValuesA))
preview = CustomPreview(Geometry=sort.ValuesA, Material=gradient)

# ----
# Make 2d to desired frame
named_views = QueryNamedViews(AutoUpdateState=True)
item_8 = ListItem(List=named_views, Index=Slider(1, range=0..1), Wrap=True)
make2d = Make2D(Geometry=item_3, View=item_8, TangentEdges=True, TangentSeams=True, AutoComputeMake2D=False)  # -> VisibleCurves, VisibleIndex, VisibleType, HiddenCurves, HiddenIndex, HiddenType
pt_7 = Point(Point(-4.621047685, -143.5165657, 0))
item_9 = ListItem(List=move_2.Geometry, Index=Slider(3, range=0..10), Wrap=True)
vec2pt = Vector2Pt(PointA=pt_7, PointB=item_9, Unitize=False)  # -> Vector, Length
vec = VectorXYZ(XComponent=0, YComponent=Slider(50, range=0..100), ZComponent=0)  # -> Vector, Length
addition_4 = Addition(A=vec2pt.Vector, B=vec.Vector)
move_6 = Move(Geometry=make2d.VisibleCurves, Motion=addition_4)  # -> flatten(Geometry), Transform
join = JoinCurves(Curves=move_6.Geometry, Preserve=False)

named_views_2 = QueryNamedViews(AutoUpdateState=True)
item_10 = ListItem(List=named_views_2, Index=Slider(1, range=0..1), Wrap=True)
make2d_2 = Make2D(Geometry=crv_4, View=item_10, TangentEdges=True, TangentSeams=True, AutoComputeMake2D=False)  # -> VisibleCurves, VisibleIndex, VisibleType, HiddenCurves, HiddenIndex, HiddenType
pt_8 = Point(Point(-4.621047685, -143.5165657, 0))
item_11 = ListItem(List=move_2.Geometry, Index=Slider(3, range=0..10), Wrap=True)
vec2pt_2 = Vector2Pt(PointA=pt_8, PointB=item_11, Unitize=False)  # -> Vector, Length
vec_2 = VectorXYZ(XComponent=0, YComponent=Slider(50, range=0..100), ZComponent=0)  # -> Vector, Length
addition_5 = Addition(A=vec2pt_2.Vector, B=vec_2.Vector)
move_7 = Move(Geometry=make2d_2.VisibleCurves, Motion=addition_5)  # -> flatten(Geometry), Transform

lng_2 = ListLength(List=gradient)
series_3 = Series(Start=0, Step=1, Count=lng_2)
concat = Concatenate(FragmentA="SubLayer", FragmentB=series_3)
concat_2 = Concatenate(FragmentA="05-Surface::", FragmentB=concat)
layers = CreateModifyLayers(LayerName=concat_2, LayerColor=gradient, PrintColor=gradient, DeleteLayer=Toggle(False), enableFullPath=True)  # -> LayerNames, LayerFullPath
createatts = CreateAttributes(LayerName=layers.LayerNames, enableFullPath=False)

swatch = ColourSwatch(SwatchColor=RGB(0, 0, 0))
layers_2 = CreateModifyLayers(
    LayerName="01-Line Thick",
    LayerColor=swatch,
    PrintWidth=Slider(3, range=0..10),
    PrintColor=swatch,
    DeleteLayer=False,
    enableFullPath=False)  # -> LayerNames, LayerFullPath
createatts_2 = CreateAttributes(LayerName=layers_2.LayerNames, enableFullPath=False)

swatch_2 = ColourSwatch(SwatchColor=RGB(0, 0, 0))
layers_3 = CreateModifyLayers(
    LayerName="03-Line Thin",
    LayerColor=swatch_2,
    PrintWidth=Slider(1, range=0..10),
    PrintColor=swatch_2,
    DeleteLayer=False,
    enableFullPath=False)  # -> LayerNames, LayerFullPath
createatts_3 = CreateAttributes(LayerName=layers_3.LayerNames, enableFullPath=False)

# ----
# Bake
toggle = BooleanToggle(False)
crv_5 = Curve(join)
crv_6 = Curve(move_7.Geometry)
crv_7 = Curve(move_7.Geometry)
createhatch = CreateHatch(Bake=toggle, Curves=crv_7, HatchPatternName="Solid", HatchScale=1, HatchRotation=0, Attributes=createatts)  # -> HatchGeometry, HatchObjects
bake = BakeGeometry(Bake=toggle, Geometry=crv_5, Attributes=createatts_2, DeleteOldBakes=True, PreserveTrees=False)
bake_2 = BakeGeometry(Bake=toggle, Geometry=crv_6, Attributes=createatts_3, DeleteOldBakes=True, PreserveTrees=False)
